# Grasshopper definition read point.gh (Grasshopper 1.0.7)

path = FilePath("/Users/jhorikawa/Desktop/point plotting/test.csv")
python = GhPythonScript(file=path)  # -> out, a
# ---------- python: Python ----------
__author__ = "jhorikawa"

import rhinoscriptsyntax as rs

file = open(file, "r")
a = file.readlines()
# ---------- end python ----------
split = TextSplit(Text=python.a, Separators=",")
flip = FlipMatrix(Data=split)  # -> simplify(Data)
bang = ExplodeTree(Data=flip)  # -> Branch0, Branch1, Branch2
panel = Panel(split)
neg = Negative(Value=bang.Branch2)
neg_2 = Negative(Value=bang.Branch1)
pt = ConstructPoint(XCoordinate=bang.Branch0, YCoordinate=neg, ZCoordinate=neg_2)
